# Grasshopper definition working-template_v1.0.1.gh (Grasshopper 1.0.8)

crv = Curve(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)
pattern_gen_util = PatternGenUtil()  # -> flatten(pattcrvs_2)
boundary_panel = BoundaryPanel()  # -> Panels; inputs Bnd: Curve, SheetX: Double, SheetY: Double, UseWorldXY: Boolean
# ---------- boundary_panel: Python ----------
import Rhino
import scriptcontext as sc
from Rhino.Geometry import Plane, Rectangle3d, Interval

# Inputs:
#   Bnd        : Curve
#   SheetX     : float
#   SheetY     : float
#   UseWorldXY : bool
#
# Output:
#   Panels     : list[Curve]


def _doc_tol():
    if sc.doc:
        return sc.doc.ModelAbsoluteTolerance
    if Rhino.RhinoDoc.ActiveDoc:
        return Rhino.RhinoDoc.ActiveDoc.ModelAbsoluteTolerance
    return 1e-3


def sizes_1d(L, S, tol):
    """
    Fills length L with:
    - as many full sheets S as possible
    - remainder split equally into two end caps
    - full sheets centered between caps
    """
    if S <= tol:
        return [L]

    n_full = int(L // S)
    rem = L - (n_full * S)

    if abs(rem) <= tol:
        return [S] * n_full

    cap = 0.5 * rem

    if cap <= tol:
        return [S] * n_full

    return [cap] + ([S] * n_full) + [cap]


Panels = []

if Bnd is None:
    Panels = []
else:
    tol = _doc_tol()

    # Choose working plane
    if UseWorldXY:
        pl = Plane.WorldXY
    else:
        ok, pl = Bnd.TryGetPlane(tol)
        if not ok:
            pl = Plane.WorldXY

    # Bounding box in chosen plane
    bb = Bnd.GetBoundingBox(pl)

    Lx = bb.Max.X - bb.Min.X
    Ly = bb.Max.Y - bb.Min.Y

    x_sizes = sizes_1d(Lx, float(SheetX), tol)
    y_sizes = sizes_1d(Ly, float(SheetY), tol)

    x0 = bb.Min.X
    for sx in x_sizes:
        y0 = bb.Min.Y
        for sy in y_sizes:
            rect = Rectangle3d(
                pl,
                Interval(x0, x0 + sx),
                Interval(y0, y0 + sy)
            )
            Panels.append(rect.ToNurbsCurve())
            y0 += sy
        x0 += sx
# ---------- end boundary_panel ----------
contour_from_points = ContourFromPoints()  # -> Curves; inputs Points: list of Point3d, Surface: Surface
# ---------- contour_from_points: Python ----------
"""GhPython Component
Inputs:
    Points:  List[Rhino.Geometry.Point3d] (section locations; typically y=0)
    Surface: Rhino surface or brep to contour

Outputs:
    Curves:  List[Rhino.Geometry.Curve] resulting from cutting with YZ planes at each unique X
"""

import Rhino
import scriptcontext as sc
from Rhino.Geometry import Point3d, Plane, Brep

# --- Helpers ---------------------------------------------------------------

def get_model_tol(default=0.01):
    try:
        if sc.doc and hasattr(sc.doc, "ModelAbsoluteTolerance"):
            return sc.doc.ModelAbsoluteTolerance
        if Rhino.RhinoDoc.ActiveDoc:
            return Rhino.RhinoDoc.ActiveDoc.ModelAbsoluteTolerance
    except:
        pass
    return default

def to_brep(geo):
    """Accept Brep or Surface; return Brep or None."""
    if isinstance(geo, Brep):
        return geo
    # Surfaces in GH often come in as Rhino.Geometry.Surface or BrepFace
    if hasattr(geo, "ToBrep"):
        try:
            return geo.ToBrep()
        except:
            return None
    return None

def unique_x_values(points, tol):
    """Cluster points by X within tolerance and return sorted representative X values."""
    if tol <= 0: tol = 1e-6
    scale = 1.0 / tol
    buckets = {}
    # Ensure iterable
    seq = points if isinstance(points, (list, tuple)) else [points]
    for p in seq:
        if not isinstance(p, Point3d):
            continue
        key = int(round(p.X * scale))
        if key in buckets:
            buckets[key] = min(buckets[key], p.X)
        else:
            buckets[key] = p.X
    return sorted(buckets.values())

def yz_plane_at_x(x):
    """YZ plane translated to given X."""
    pl = Plane.WorldYZ
    pl.Origin = Point3d(x, 0.0, 0.0)
    return pl

# --- Main ------------------------------------------------------------------

Curves = []

if Surface is None or Points is None:
    pass
else:
    tol = get_model_tol()
    brep = to_brep(Surface)

    if brep is None:
        # Nothing to contour
        Curves = []
    else:
        xs = unique_x_values(Points, tol)
        for x in xs:
            pl = yz_plane_at_x(x)
            try:
                # This reliably returns IEnumerable[Curve]
                crvs = Brep.CreateContourCurves(brep, pl)
            except Exception:
                crvs = None

            if crvs:
                # Filter tiny/invalid results
                for c in crvs:
                    if c and c.IsValid and c.GetLength() > tol:
                        Curves.append(c)
# ---------- end contour_from_points ----------
eval_variable_density = EvalVariableDensity()  # -> Pts, t; inputs Crv: Curve, FalloffMode: Int32
# ---------- eval_variable_density: Python ----------
"""GhPython Component: Variable-density curve sampling (focus as ratio, falloff as slider)

Inputs:
    Crv:          Rhino.Geometry.Curve
    Focus:        float in [0..1] — where density is highest (reparameterized along length)
    MinS:         float > 0 — minimum spacing (most dense)
    MaxS:         float >= MinS — maximum spacing (least dense)
    Radius:       float > 0 — influence radius in length units
    FalloffMode:  int in {0,1,2} — 0:Gaussian, 1:Smooth, 2:Linear

Outputs:
    Pts:          list[Rhino.Geometry.Point3d]
    t:            list[float] curve parameters at sampled points
"""

import math
from Rhino.Geometry import Curve, Point3d, Interval

# -------------------------- Utilities --------------------------------------

def clamp(x, a, b):
    return a if x < a else (b if x > b else x)

def length_to_param(crv, s):
    rc, tt = crv.LengthParameter(s)
    if rc: return tt
    # Edge clamp fallback
    return crv.Domain.T0 if s <= 0.0 else crv.Domain.T1

def param_to_length(crv, tt):
    return crv.GetLength(Interval(crv.Domain.T0, tt))

def falloff_weight(u, mode):
    """u = normalized distance d/Radius >=0. Return weight in [0..1]."""
    if mode == 0:  # Gaussian
        return math.exp(-0.5 * u * u)
    elif mode == 1:  # Smooth (compact C1, falls to 0 at u>=1)
        u = clamp(u, 0.0, 1.0)
        s = u*u*(3.0 - 2.0*u)  # smoothstep
        return 1.0 - s
    elif mode == 2:  # Linear (compact)
        return max(0.0, 1.0 - u)
    # default to Gaussian
    return math.exp(-0.5 * u * u)

def spacing_at_length(s, s_focus, minS, maxS, radius, mode):
    """Local spacing field s(l) given arc-length l and focus location."""
    if radius <= 0.0:
        return maxS
    d = abs(s - s_focus)
    w = falloff_weight(d / radius, mode)
    return maxS - (maxS - minS) * w

def march(crv, start_len, direction, minS, maxS, radius, mode, end_len):
    """Step from start_len toward end_len (direction = +1 or -1) with variable spacing."""
    pts, ts = [], []
    t0 = length_to_param(crv, start_len)
    pts.append(crv.PointAt(t0))
    ts.append(t0)

    s_focus = start_len
    s = start_len
    L = crv.GetLength()
    max_iters = 100000
    it = 0

    while True:
        it += 1
        if it > max_iters:
            break

        local = spacing_at_length(s, s_focus, minS, maxS, radius, mode)
        local = max(local, 1e-9)

        s_next = s + direction * local
        if direction > 0 and s_next > end_len: break
        if direction < 0 and s_next < end_len: break

        t_next = length_to_param(crv, s_next)
        pts.append(crv.PointAt(t_next))
        ts.append(t_next)
        s = s_next

    return pts, ts

# -------------------------- Main -------------------------------------------

Pts, t = [], []

if Crv is None or not isinstance(Crv, Curve):
    pass
else:
    L = Crv.GetLength()
    if L > 0:
        # Sanitize inputs
        Focus = 0.0 if Focus is None else clamp(float(Focus), 0.0, 1.0)
        MinS = 0.1 if (MinS is None or MinS <= 0.0) else float(MinS)
        MaxS = float(MaxS) if (MaxS is not None and MaxS >= MinS) else MinS
        Radius = float(Radius) if (Radius is not None and Radius > 0.0) else (0.25 * L)
        mode = int(FalloffMode) if FalloffMode is not None else 0
        if mode not in (0,1,2): mode = 0

        # Resolve focus as arc length (ratio * total length)
        s_focus = Focus * L

        # March outwards from focus in both directions
        f_pts, f_ts = march(Crv, s_focus, +1, MinS, MaxS, Radius, mode, L)
        b_pts, b_ts = march(Crv, s_focus, -1, MinS, MaxS, Radius, mode, 0.0)

        # Ensure curve ends included
        # Start
        if not b_ts or abs(b_ts[-1] - Crv.Domain.T0) > 1e-12:
            b_pts.append(Crv.PointAt(Crv.Domain.T0))
            b_ts.append(Crv.Domain.T0)
        # End
        if not f_ts or abs(f_ts[-1] - Crv.Domain.T1) > 1e-12:
            f_pts.append(Crv.PointAt(Crv.Domain.T1))
            f_ts.append(Crv.Domain.T1)

        # Merge: backward (from start -> focus), then forward (focus -> end)
        b_pts = list(reversed(b_pts))
        b_ts  = list(reversed(b_ts))

        # Avoid duplicate focus point if both sides share it
        if b_ts and f_ts and abs(b_ts[-1] - f_ts[0]) < 1e-12:
            Pts = b_pts + f_pts[1:]
            t   = b_ts  + f_ts[1:]
        else:
            Pts = b_pts + f_pts
            t   = b_ts  + f_ts
# ---------- end eval_variable_density ----------
grid_in_region = GridInRegion()  # -> GridCells, R, C; inputs B: Curve, RadX: Double, RadY: Double, Type: Boolean
# ---------- grid_in_region: Python ----------
import math
import Rhino
from Rhino.Geometry import Point3d, Polyline, PolylineCurve
from Rhino.Geometry.Intersect import Intersection
from Grasshopper import DataTree
from Grasshopper.Kernel.Data import GH_Path

def _is_closed_planar(crv, tol):
    if crv is None: return False
    if not crv.IsClosed: return False
    ok, _ = crv.TryGetPlane(tol)
    return ok

def _curve_plane(crv, tol):
    ok, pln = crv.TryGetPlane(tol)
    return pln if ok else None

def _hex_pts_xy(cx, cy, rx, ry):
    # pointy-top hex; rx stretches X, ry stretches Y
    pts = []
    for k in range(6):
        ang = math.radians(30.0 + 60.0 * k)
        pts.append((cx + rx * math.cos(ang), cy + ry * math.sin(ang)))
    return pts

def _rect_pts_xy(cx, cy, rx, ry):
    # axis-aligned rectangle; if rx==ry it's a square
    return [
        (cx - rx, cy - ry),
        (cx + rx, cy - ry),
        (cx + rx, cy + ry),
        (cx - rx, cy + ry),
    ]

def _poly_fully_inside(cell_crv, boundary, plane, tol):
    ok, pl = cell_crv.TryGetPolyline()
    if not ok:
        return False

    # all vertices must be inside (or on boundary)
    for i in range(pl.Count - 1):
        if boundary.Contains(pl[i], plane, tol) == Rhino.Geometry.PointContainment.Outside:
            return False

    # any intersection (including touching) rejects
    x = Intersection.CurveCurve(cell_crv, boundary, tol, tol)
    if x and x.Count > 0:
        return False

    return True

# ----------------------------
# Main
# ----------------------------
GridCells = []
R = DataTree[object]()  # rows
C = DataTree[object]()  # cols

if B is None or RadX is None:
    GridCells = []
else:
    tol = Rhino.RhinoDoc.ActiveDoc.ModelAbsoluteTolerance if Rhino.RhinoDoc.ActiveDoc else 1e-6

    rx = float(RadX)
    if rx <= 0.0:
        GridCells = []
    else:
        # Critical rule: if RadY == 0 -> regular polygons
        if RadY is None:
            ry = rx
        else:
            ry_in = float(RadY)
            ry = rx if abs(ry_in) <= tol else ry_in

        if not _is_closed_planar(B, tol):
            GridCells = []
        else:
            plane = _curve_plane(B, tol)

            # boundary plane coords -> World XY
            xform_w2p = Rhino.Geometry.Transform.ChangeBasis(plane, Rhino.Geometry.Plane.WorldXY)
            xform_p2w = Rhino.Geometry.Transform.ChangeBasis(Rhino.Geometry.Plane.WorldXY, plane)

            B2 = B.DuplicateCurve()
            B2.Transform(xform_w2p)

            mp = Rhino.Geometry.AreaMassProperties.Compute(B2)
            ctr2 = mp.Centroid if mp else B2.GetBoundingBox(True).Center

            use_hex = True if Type else False

            # Grid spacing derived from rx/ry
            if use_hex:
                dx = math.sqrt(3.0) * rx
                dy = 1.5 * ry
            else:
                dx = 2.0 * rx
                dy = 2.0 * ry

            bb = B2.GetBoundingBox(True)
            minx = bb.Min.X - 2.0 * dx
            maxx = bb.Max.X + 2.0 * dx
            miny = bb.Min.Y - 2.0 * dy
            maxy = bb.Max.Y + 2.0 * dy

            j_min = int(math.floor((miny - ctr2.Y) / dy)) - 1
            j_max = int(math.ceil((maxy - ctr2.Y) / dy)) + 1
            i_min = int(math.floor((minx - ctr2.X) / dx)) - 1
            i_max = int(math.ceil((maxx - ctr2.X) / dx)) + 1

            cells_by_row = {}  # j -> list of (i, curve)
            cells_by_col = {}  # i -> list of (j, curve)

            for j in range(j_min, j_max + 1):
                y = ctr2.Y + j * dy
                row_offset = (0.5 * dx if (use_hex and (j & 1)) else 0.0)

                for i in range(i_min, i_max + 1):
                    x = ctr2.X + i * dx + row_offset
                    cpt2 = Point3d(x, y, 0.0)

                    # quick cull: center must be inside
                    if B2.Contains(cpt2, Rhino.Geometry.Plane.WorldXY, tol) == Rhino.Geometry.PointContainment.Outside:
                        continue

                    # build candidate cell in plane coords (WorldXY)
                    if use_hex:
                        verts = _hex_pts_xy(x, y, rx, ry)
                    else:
                        verts = _rect_pts_xy(x, y, rx, ry)

                    pts = [Point3d(vx, vy, 0.0) for (vx, vy) in verts]
                    pts.append(pts[0])

                    pline = Polyline(pts)
                    if not pline.IsValid:
                        continue

                    cell2 = PolylineCurve(pline)

                    if not _poly_fully_inside(cell2, B2, Rhino.Geometry.Plane.WorldXY, tol):
                        continue

                    cell_w = cell2.DuplicateCurve()
                    cell_w.Transform(xform_p2w)

                    GridCells.append(cell_w)
                    cells_by_row.setdefault(j, []).append((i, cell_w))
                    cells_by_col.setdefault(i, []).append((j, cell_w))

            # Rows -> R (branches ordered by j, items ordered by i)
            row_keys = sorted(cells_by_row.keys())
            for r_idx, j in enumerate(row_keys):
                path = GH_Path(r_idx)
                for (_, crv) in sorted(cells_by_row[j], key=lambda t: t[0]):
                    R.Add(crv, path)

            # Cols -> C (branches ordered by i, items ordered by j)
            col_keys = sorted(cells_by_col.keys())
            for c_idx, i in enumerate(col_keys):
                path = GH_Path(c_idx)
                for (_, crv) in sorted(cells_by_col[i], key=lambda t: t[0]):
                    C.Add(crv, path)
# ---------- end grid_in_region ----------
split_point_interpolate = SplitPointInterpolate()  # -> Crvs, PtTree; inputs Pts: list of Point3d
# ---------- split_point_interpolate: Python ----------
"""
GhPython: split non-continuous point sets into curve segments.

Inputs:
    Pts:    list[Rhino.Geometry.Point3d]  - all points, in order
    MaxGap: float                         - max distance allowed inside a segment

Outputs:
    Crvs:   list[Rhino.Geometry.Curve]    - one curve per continuous segment
    PtTree: Grasshopper.DataTree[Point3d] - points grouped by segment (one branch per segment)
"""

import Rhino.Geometry as rg
from Grasshopper import DataTree
from Grasshopper.Kernel.Data import GH_Path

Crvs = []
PtTree = DataTree[rg.Point3d]()

# Auto-estimate MaxGap if needed
if MaxGap <= 0:
    dists = []
    for i in range(1, len(Pts)):
        dists.append(Pts[i - 1].DistanceTo(Pts[i]))
    if dists:
        dists_sorted = sorted(dists)
        mid = len(dists_sorted) // 2
        median = dists_sorted[mid]
        MaxGap = 1.5 * median

# Split into continuous segments
segments = []
current = [Pts[0]]

for i in range(1, len(Pts)):
    a = Pts[i - 1]
    b = Pts[i]
    d = a.DistanceTo(b)

    if d <= MaxGap:
        # Still in the same continuous run
        current.append(b)
    else:
        # Gap detected: close current segment and start a new one
        if len(current) >= 2:
            segments.append(current)
        current = [b]

# Add the last segment
if len(current) >= 2:
    segments.append(current)

# Build curves + point tree for each segment
for seg_index, seg in enumerate(segments):
    # Interpolated curve, degree 3
    crv = rg.Curve.CreateInterpolatedCurve(seg, 3)
    if crv:
        Crvs.append(crv)

    # Add points to the DataTree, one branch per segment
    path = GH_Path(seg_index)
    for pt in seg:
        PtTree.Add(pt, path)
# ---------- end split_point_interpolate ----------
linear_nesting = LinearNesting()  # -> StockLines, CutLines, StickIds; inputs L: list
# ---------- linear_nesting: Python ----------
"""Cut stock nesting visualizer (1D) for Grasshopper

Inputs:
    L        : list[float]  - required cut lengths (same units as StockLen)
    StockLen : float        - stock length (e.g. 288 for 24')
    Spacing  : float        - vertical spacing between each stock bar in the drawing

Outputs:
    StockLines : list[rg.Line] - full-length stock bars
    CutLines   : list[rg.Line] - one line per cut, positioned on its stock bar
    StickIds   : list[int]     - index of stock bar for each cut (0-based)
"""

import Rhino.Geometry as rg

# ----------------------------------------------------------------------
# Initialize outputs
# ----------------------------------------------------------------------
StockLines = []
CutLines = []
StickIds = []

# ----------------------------------------------------------------------
# Coerce and validate inputs (no top-level returns)
# ----------------------------------------------------------------------

# Stock length
stock_len = 0.0
if StockLen is not None:
    try:
        stock_len = float(StockLen)
    except:
        stock_len = 0.0

# Spacing between stock bars
spacing = 0.0
if Spacing is not None:
    try:
        spacing = float(Spacing)
    except:
        spacing = 0.0

if spacing < 0.0:
    spacing = 0.0

# Collect valid cut lengths
cuts_raw = []
if L is not None:
    for x in L:
        if x is None:
            continue
        try:
            v = float(x)
        except:
            continue
        if v > 0.0:
            cuts_raw.append(v)

# If inputs are not usable, do nothing (outputs stay empty)
if stock_len <= 0.0:
    # invalid stock length
    pass
elif not cuts_raw:
    # no valid cuts
    pass
else:
    # ------------------------------------------------------------------
    # First-Fit Decreasing bin packing (no kerf)
    # ------------------------------------------------------------------

    # Sort cuts from longest to shortest
    cuts_sorted = sorted(cuts_raw, reverse=True)

    # Each stick = {'used': float, 'cuts': [lengths]}
    sticks = []

    for c_len in cuts_sorted:
        placed = False

        # Try to place in existing sticks
        for stick in sticks:
            if stick['used'] + c_len <= stock_len + 1e-6:
                stick['cuts'].append(c_len)
                stick['used'] += c_len
                placed = True
                break

        # If it did not fit anywhere, start a new stick
        if not placed:
            sticks.append({'cuts': [c_len], 'used': c_len})

    # ------------------------------------------------------------------
    # Generate 2D line geometry
    # ------------------------------------------------------------------

    for si, stick in enumerate(sticks):
        # Vertical position for this stock bar
        y = si * spacing

        # Full stock line
        stock_start = rg.Point3d(0.0, y, 0.0)
        stock_end   = rg.Point3d(stock_len, y, 0.0)
        StockLines.append(rg.Line(stock_start, stock_end))

        # Cuts laid out from left to right along this bar
        x = 0.0
        for c_len in stick['cuts']:
            p0 = rg.Point3d(x, y, 0.0)
            p1 = rg.Point3d(x + c_len, y, 0.0)
            CutLines.append(rg.Line(p0, p1))
            StickIds.append(si)
            x += c_len
# ---------- end linear_nesting ----------
boundary_panel_2 = BoundaryPanel(Bnd=crv, SheetX=Slider(120, range=0..1000), SheetY=Slider(60, range=0..1000), UseWorldXY=Slider(1, range=0..1))  # -> Panels; inputs Bnd: Curve, SheetX: Double, SheetY: Double, UseWorldXY: Boolean; same code as boundary_panel
# # DEFINITION STANDARD DOC
# 
# ## PURPOSE
# 
# THIS DOCUMENT SERVES AS THE SSOT FOR PARAMETRIC DESIGN CREATION, WORKFLOWS, AND SOP.
# 
# ## METADATA
# 
# CURRENT AUTHOR: FH
# DATE CREATED: 5 MARCH 2026
# LAST MODIFIED: 5 MARCH 2026
# 
# ## RELEASE NOTES
# 
# VERSION: 0.0.0
# NOTES: CREATED THE DOCUMENT
crv_2 = Curve(crv)
crv_3 = Curve(boundary_panel_2)
grid_in_region_2 = GridInRegion(B=boundary_panel_2, RadX=Slider(4, range=0..10), Type=Slider(1, range=0..1))  # -> GridCells, R, C; inputs B: Curve, RadX: Double, RadY: Double, Type: Boolean; same code as grid_in_region
crv_4 = Curve(flatten(grid_in_region_2.GridCells))
crv_5 = Curve(crv_4)
crv_6 = Curve(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)
area = Area(Geometry=crv_4)  # -> Area, Centroid
crv_7 = Curve(crv_6)
curve_attractor = CurveAttractor(C=crv_6, P=area.Centroid, A=Slider(0.22, range=0..10), B=Slider(0.88, range=0..10))  # -> R, points_on_curve_2
scale = Scale(Geometry=crv_4, Center=area.Centroid, Factor=curve_attractor.R)  # -> Geometry, Transform
crv_8 = Curve(scale.Geometry)

# ==== cluster CurveAttractor: Utility
C = ClusterInput()
P = ClusterInput()
x = ClusterInput()
A = ClusterInput()
B = ClusterInput()
crv_cp = CurveClosestPoint(Point=P, Curve=C)  # -> Point, Parameter, Distance
dom = ConstructDomain(DomainStart=A, DomainEnd=B)
bnd = Bounds(Numbers=crv_cp.Distance)
remap = RemapNumbers(Value=crv_cp.Distance, Source=bnd, Target=dom)  # -> Mapped, Clipped
R = ClusterOutput(remap.Mapped)
points_on_curve = Point(crv_cp.Point)
points_on_curve_2 = ClusterOutput(points_on_curve)

# ==== cluster PatternGenUtil: Pattern Gen Util
gridcells = ClusterInput()
gridcells_2 = Curve(gridcells)
flatten = FlattenTree(Tree=gridcells_2, Path="{0}")
cellsegptseval = ClusterInput()
splitsegpteval = ClusterInput()
splitvert = ClusterInput()
cellsegscale = ClusterInput()
incircscale = ClusterInput()
incircdivs = ClusterInput()
cellscale = ClusterInput()
item = ListItem(List=flatten, Index=0, Wrap=True)
area = Area(Geometry=flatten)  # -> Area, Centroid
cellsegptseval_2 = Number(cellsegptseval)
area_2 = Area(Geometry=item)  # -> Area, Centroid
cellscale_2 = Number(cellscale)
cellsegscale_2 = Number(cellsegscale)
explode = Explode(Curve=item, Recursive=True)  # -> Segments, Vertices
splitsegpteval_2 = Number(splitsegpteval)
splitvert_2 = Number(splitvert)
disc = Discontinuity(Curve=item, Level=1)  # -> Points, Parameters
pt = Point(area_2.Centroid)
item_2 = ListItem(List=disc.Points, Index=0, Wrap=True)
ln = Line(StartPoint=pt, EndPoint=item_2)
dispatch = Dispatch(List=disc.Points, DispatchPattern=[True, False])  # -> ListA, ListB
len = Length(Curve=ln)
eval = EvaluateCurve(Curve=reparameterize(explode.Segments), Parameter=cellsegptseval_2)  # -> Point, Tangent, Angle
cir = Circle(Plane=pt, Radius=len)
incircscale_2 = Number(incircscale)
incircdivs_2 = Number(incircdivs)
dispatch_2 = Dispatch(List=eval.Point, DispatchPattern=[True, False])  # -> ListA, ListB
scale = Scale(Geometry=cir, Center=pt, Factor=incircscale_2)  # -> Geometry, Transform
expression = Expression(x=cellsegscale_2, Expression="1-x")
expression_2 = Expression(x=cellscale_2, Expression="1-x")
scale_2 = Scale(Geometry=disc.Points, Center=pt, Factor=cellscale_2)  # -> Geometry, Transform
scale_3 = Scale(Geometry=eval.Point, Center=pt, Factor=cellsegscale_2)  # -> Geometry, Transform
scale_4 = Scale(Geometry=dispatch_2.ListA, Center=pt, Factor=cellsegscale_2)  # -> Geometry, Transform
scale_5 = Scale(Geometry=dispatch_2.ListB, Center=pt, Factor=expression)  # -> Geometry, Transform
scale_6 = Scale(Geometry=dispatch.ListA, Center=pt, Factor=cellscale_2)  # -> Geometry, Transform
scale_7 = Scale(Geometry=dispatch.ListB, Center=pt, Factor=expression_2)  # -> Geometry, Transform
divide = DivideCurve(Curve=scale.Geometry, Count=incircdivs_2, Kinks=False)  # -> Points, Tangents, Parameters
merge = Merge(Data1=scale_4.Geometry, Data2=scale_5.Geometry)  # -> flatten(Result)
pt_2 = Point(disc.Points)
pt_3 = Point(divide.Points)
filter = StreamFilter(Gate=splitsegpteval_2, Stream0=scale_3.Geometry, Stream1=merge)
pt_4 = Point(filter)
merge_2 = Merge(Data1=scale_6.Geometry, Data2=scale_7.Geometry)  # -> flatten(Result)
filter_2 = StreamFilter(Gate=splitvert_2, Stream0=scale_2.Geometry, Stream1=merge_2)
pt_5 = Point(filter_2)
merge_3 = Merge(Data1=pt_2, Data2=pt_5, Data3=pt_3, Data4=pt_4)  # -> flatten(Result)
voronoi = Voronoi(Points=flatten(merge_3), BruteForceOverride=False)
bbx = BrepBrep(BrepA=voronoi, BrepB=item)  # -> Curves, Points
ln_2 = Line(StartPoint=pt, EndPoint=area.Centroid)
move = Move(Geometry=bbx.Curves, Motion=ln_2)  # -> Geometry, Transform
pattcrvs = Curve(move.Geometry)
pattcrvs_2 = ClusterOutput(pattcrvs)
